vi "index.gviweb"   [G Web Development Software 22.3.0]
panel controls:
  "Exit (development only)": bool
  "Test Start": bool
  "Test Steps": T3[]
  "Cancel": bool
panel indicators:
  "Test Duration (s)": f64
  "Step Status": T1[]
  "Program Log": string
  "Program Status": string
  "Initialized": bool
  "Finalized": bool
  "Graph": f64[][]
  "Result": bool
types:
  "Color.gtype" = u32
  T1 = cluster{"Progress": f64, "Result": "Color.gtype"}
  T2 = cluster{"Waveform": enum{"Constant", "Sawtooth", "Sinusoid"}, "Amplitude": f64, "Frequency": f64}
  T3 = cluster{"Duration (s)": f64, "Waveform Data": T2, "Fault Probability": f64}
  "Step Result.gtype" = enum{"Pass", "Fail", "Canceled"}
  "Step Status.gtype" = cluster{"Progress": f64, "Result": "Step Result.gtype", "Complete": bool}
  "Waveforms.gtype" = enum{"Constant", "Sawtooth", "Sinusoid"}
  "Waveform Data.gtype" = cluster{"Waveform": "Waveforms.gtype", "Amplitude": f64, "Frequency": f64}
  "Test Step Data.gtype" = cluster{"Duration (s)": f64, "Waveform Data": "Waveform Data.gtype", "Fault Probability": f64}
  "IO Data.gtype" = cluster{"Waveform": "Waveforms.gtype", "Duration (s)": f64, "Start Time": timestamp, "Time Factor": f64, "Adjusted Amplitude": f64, "New Wave": bool, "Wave Active": bool, "Fault start time": f64}
  "Manager State.gtype" = enum{"Idle", "Initialize", "Execute", "Finalize", "Cancel", "Error"}
  "Message Queue Names.gtype" = enum{"Manager", "UI", "IO"}
  "Step Data.gtype" = cluster{"Message Queue": "Message Queue Names.gtype", "Action": string}
  "Sequence.gtype" = cluster{"Manager State": "Manager State.gtype", "Steps": "Step Data.gtype"[]}
  "Manager Data.gtype" = cluster{"Current State": "Manager State.gtype", "Current Step": "Step Data.gtype", "Remaining Steps": "Step Data.gtype"[], "Remaining Sequences": "Sequence.gtype"[], "Current Instruction": string}
  "Error Data.gtype" = cluster{"Error Origin": "Message Queue Names.gtype", "Error In": error}
uses:
  WebApp::support::Message Queue::Create All Message Queues.gvi
  WebApp::support::Message Queue::Dequeue Message.gvi
  WebApp::UI::Define Preset Test Sequence.gviweb
  WebApp::UI::Prep Step Staus for Display.gviweb
  WebApp::UI::Calculate Test Duration.gviweb
  WebApp::UI::Validate Test Sequence.gviweb
  WebApp::program instructions::Report Step Complete.gviweb
  WebApp::UI::IO Data::Handle Data Remaining in Queue.gviweb
  WebApp::UI::Get Result Color.gviweb
  WebApp::UI::IO Data::Receive IO Data.gviweb
  WebApp::support::Generate Undefined Message Error.gviweb
  WebApp::support::Handle Error.gviweb
  WebApp::support::globals.gviweb
  WebApp::IO::Handle Next Waveform.gviweb
  WebApp::IO::Generate Waveform.gviweb
  WebApp::IO::Handle Hardware IO.gviweb
  WebApp::development::Check Test Sequence Complete.gviweb
  WebApp::IO::Calculate Target Value.gviweb
  WebApp::program instructions::Define Program Instructions.gviweb
  WebApp::support::Message Queue::Enqueue Message (Single).gvi
  WebApp::UI::Messages::Append Log Text.gviweb
  WebApp::program instructions::Handle Next Sequence.gviweb
  WebApp::program instructions::Handle Next Step.gviweb
  NI::G Core::Error::Build Error Cluster.gvi
  WebApp::UI::Messages::Send Sequence Complete UI Updates.gviweb
  WebApp::UI::Messages::Update Program Status.gviweb
  WebApp::support::Error Handler - Event Handling Loop.gvi
diagram:
  # #development
  # #build
  Property Node(instance in=reference to "Exit (development only)", "Visible"=FALSE) -> (error out=w1)
  w2 = bool FALSE  # Stop Event
  Create User Event[EventName="Stop Event"](error in=w1, user event data type=w2) -> (error out=w3, user event out=w4)
  Obtain Queue(element data type=f64[] [], name="IO data") -> (error out=w5, queue out=w6)
  w7 = ["Manager", "UI", "IO"]  # Queue List
  # #feature_queue
  # Hardware fault
  # 	be able to clear error with corresponding case in IO
  # 	handle during initialize or execute
  # Abort
  # Pause
  # Pass initial instruction data to individual steps
  # Display test history/ data
  # Select between historical test data for display
  # 	Historical analysis/ comparison
  # Splining/ smooth transitions between waveforms
  # 	Force sawtooth to return to 0 before waveform transition?
  # Unit tests
  # Check for empty test sequence
  Array Size(array=w7) -> (size(s)=w8)
  call "Create All Message Queues.gvi"(Loop Count=w8, error in=w3) -> (Message Queues=w9, error out=w10)
  Array Index(array=w9) -> (out0["Manager"]=w11, out1["UI"]=w12)
  Merge Errors(w10, w5) -> (error out=w13)
  s1 = uninitialised  # shift register
  s2 = uninitialised  # shift register
  s3 = uninitialised  # shift register
  s4 = uninitialised  # shift register
  s5 = uninitialised  # shift register
  s6 = uninitialised  # shift register
  while {
    call "Dequeue Message.gvi"(message queue in=w12, timeout in milliseconds=s2, error in=w13) -> (timed out?=w14, message queue out=w15, message=w16, message data=w17, error out=w18)
    # UI Update Loop
    # s6: Step Index
    # s5: Test Steps
    # s2: Dequeue Timeout
    case (w16) ignore case {  # Message Cases
      frame "SW Init" {
        Property Node(instance in=reference to "Result", "Value"=FALSE, "Text"=[" ", " "])
        Property Node(instance in=reference to "Initialized", "Value"=FALSE)
        Property Node(instance in=reference to "Finalized", "Value"=FALSE)
        Property Node(instance in=reference to "Finalized", "Value"=FALSE)
        Property Node(instance in=reference to "Test Steps", "Disabled"=FALSE)
        Property Node(instance in=reference to "Initialized", "Value"=FALSE, error in=w18) -> (error out=w27, instance out=w28)
        Property Node(instance in=reference to "Program Status", "Value"="Idle", error in=w18) -> (error out=w29, instance out=w30)
        Property Node(instance in=reference to "Program Log", "Value"="", error in=w18) -> (error out=w31, instance out=w32)
        Build Array(w28, w30, w32) -> w33
        Merge Errors(w27, w29, w31) -> (error out=w34)
        s7 = w34  # shift register
        for {
          w35 = each element of w33
          Close Reference(error in=s7, reference=w35) -> (error out=w36)
          next s7 = w36
        }
        call "Define Preset Test Sequence.gviweb"() -> (Preset Test Sequence=w37)
        Array Size(array=w37) -> (size(s)=w25)
        Initialize Array(element="Step Status.gtype" {all zero or empty}, size=w25) -> w24
        call "Prep Step Staus for Display.gviweb"(Steps status out=w24) -> (Step Status=w38)
        Property Node(instance in=reference to "Step Status", "Value"=w38)
        call "Calculate Test Duration.gviweb"(Test Sequences=w37) -> (Total Duration (s)=w39)
        Property Node(instance in=reference to "Test Duration (s)", "Value"=w39)
        Property Node(instance in=reference to "Test Steps", "Value"=w37) -> (error out=w40)
        call "Validate Test Sequence.gviweb"(Input=reference to "Test Steps", UI Queue=w15, data=w37, error in=w40)
        w19 = s7
        w20 = default
        w21 = ""
        w22 = -1
        w23 = f64[][] []
        w26 = 0
      }
      frame "Handle Test Change" {
        Variant To Data(error in (no error)=w18, type="Test Step Data.gtype"[] [], variant=w17) -> (data=w41, error out=w42)
        Array Size(array=w41) -> (size(s)=w25)
        call "Calculate Test Duration.gviweb"(Test Sequences=w41) -> (Total Duration (s)=w43)
        $"Test Duration (s)" <- w43
        call "Validate Test Sequence.gviweb"(Input=reference to "Test Steps", UI Queue=w15, data=w41, error in=w42) -> (Error out=w19)
        w20 = default
        w21 = s1
        w22 = s2
        w23 = s3
        w24 = s4
        w26 = s6
      }
      frame "Execute" {
        # start polling to process data from IO loop
        call "Report Step Complete.gviweb"(Manager Queue=w11, This Queue Name="UI", Step Name=w16, Input_3=w18) -> (Output_2=w19)
        w20 = default
        w21 = s1
        w22 = 0
        w23 = s3
        w24 = s4
        w25 = s5
        w26 = s6
      }
      frame "Update Status" {
        Variant To Data(error in (no error)=w18, type=string "", variant=w17) -> (data=w44, error out=w19)
        Format Into String(formatString="%s\n%s", s1, w44) -> w21
        $"Program Log" <- w21
        w20 = default
        w22 = s2
        w23 = s3
        w24 = s4
        w25 = s5
        w26 = s6
      }
      frame "Update Program Status" {
        Variant To Data(error in (no error)=w18, type=w16, variant=w17) -> (data=w45, error out=w19)
        $"Program Status" <- w45
        w20 = default
        w21 = s1
        w22 = s2
        w23 = s3
        w24 = s4
        w25 = s5
        w26 = s6
      }
      frame "Initialize Complete" {
        $Initialized <- TRUE
        w19 = w18
        w20 = default
        w21 = s1
        w22 = s2
        w23 = s3
        w24 = s4
        w25 = s5
        w26 = s6
      }
      frame "Initialize" {
        Property Node(instance in=reference to "Result", "Value"=FALSE)
        Property Node(instance in=reference to "Test Steps", "Disabled"=TRUE)
        Property Node(instance in=reference to "Initialized", "Value"=FALSE)
        Property Node(instance in=reference to "Finalized", "Value"=FALSE)
        # Enure at least 1 step is present
        Max And Min(x=s5, y=1) -> (max(x,y)=w46: i32)
        Initialize Array(element="Step Status.gtype" {all zero or empty}, size=w46) -> w24
        call "Prep Step Staus for Display.gviweb"(Steps status out=w24) -> (Step Status=w47)
        Property Node(instance in=reference to "Step Status", "Value"=w47, error in=w18) -> (error out=w48)
        call "Report Step Complete.gviweb"(Manager Queue=w11, This Queue Name="UI", Step Name=w16, Input_3=w48) -> (Output_2=w19)
        w20 = default
        w21 = s1
        w22 = s2
        w23 = f64[][] []
        w25 = s5
        w26 = 0
      }
      frame "Execute Complete" {
        # Handle any data remaining in queue
        call "Handle Data Remaining in Queue.gviweb"(Input_3=reference to "Graph", Input_2=reference to "Step Status", Input_4=w6, Input_5=s6, Input=s3, Input_6=s4, Input_7=w18) -> (Output=w26, Output_3=w23, Output_4=w24, Output_2=w19)
        w20 = default
        w21 = s1
        w22 = s2
        w25 = s5
      }
      frame "Finalize" {
        s8 = "Pass"  # shift register
        for {
          w49 = each element of s4
          Property Node(instance in=w49) -> ("Result"=w50)
          case (s8) {
            frame "Pass", Default {
              w51 = w50
            }
            frame "Fail" {
              case (w50) {
                frame Default {
                  w51 = w50
                }
                frame "Pass" {
                  w51 = s8
                }
              }
            }
            frame "Canceled" {
              w52 = "Canceled"  # Step Result
              w51 = w52
            }
          }
          next s8 = w51
        }
        call "Get Result Color.gviweb"(Input=s8) -> (Output=w53)
        Format Into String(formatString="%s", s8) -> w54
        Build Array(w54) -> w55
        # stop polling
        Property Node(instance in=reference to "Result", "TrueColor"=w53, "Text"=w55)
        $Result <- TRUE
        Property Node(instance in=reference to "Test Steps", "Disabled"=TRUE)
        call "Report Step Complete.gviweb"(Manager Queue=w11, This Queue Name="UI", Step Name=w16, Input_3=w18) -> (Output_2=w19)
        w20 = default
        w21 = s1
        w22 = -1
        w23 = s3
        w24 = s4
        w25 = s5
        w26 = s6
      }
      frame "Finalize Complete" {
        $Finalized <- TRUE
        Property Node(instance in=reference to "Test Steps", "Disabled"=FALSE)
        w19 = w18
        w20 = default
        w21 = s1
        w22 = s2
        w23 = s3
        w24 = s4
        w25 = s5
        w26 = s6
      }
      frame "Cancel" {
        Array Index(array=s4) -> (out0[s6]=w56)
        Property Node(instance in=w56, "Result"="Canceled") -> (instance out=w57)
        Replace Array Subset(inArray=s4, index=s6, new=w57) -> w58
        call "Handle Data Remaining in Queue.gviweb"(Input_3=reference to "Graph", Input_2=reference to "Step Status", Input_4=w6, Input_5=s6, Input=s3, Input_6=w58, Input_7=w18) -> (Output=w26, Output_3=w23, Output_4=w24, Output_2=w59)
        call "Report Step Complete.gviweb"(Manager Queue=w11, This Queue Name="UI", Step Name=w16, Input_3=w59) -> (Output_2=w19)
        w20 = default
        w21 = s1
        w22 = s2
        w25 = s5
      }
      frame "Cancel Complete" {
        w19 = w18
        w20 = default
        w21 = s1
        w22 = s2
        w23 = s3
        w24 = s4
        w25 = s5
        w26 = s6
      }
      frame "Exit" {
        Release Queue(queue=w15) -> (error out=w60)
        Release Queue(queue=w6) -> (error out=w61)
        Merge Errors(w18, w60, w61) -> (error out=w19)
        w20 = TRUE
        w21 = s1
        w22 = s2
        w23 = s3
        w24 = s4
        w25 = s5
        w26 = s6
      }
      frame Default {
        case (w14) {
          frame True {
            Wait(time to wait=500)
            call "Receive IO Data.gviweb"(Test data in=s3, Steps status in=s4, Step Index in=s6, error in=w18, IO Data Queue=w6) -> (Test data out=w23, Steps status out=w24, Step Index out=w26, error out=w19, Test Data for Graph=w62)
            $Graph <- w62
            call "Prep Step Staus for Display.gviweb"(Steps status out=w24) -> (Step Status=w63)
            $"Step Status" <- w63
          }
          frame False {
            call "Generate Undefined Message Error.gviweb"(Queue Name="UI", Message=w16, Error in=w18) -> (Error out=w19)
            w23 = s3
            w24 = s4
            w26 = s6
          }
        }
        w20 = default
        w21 = s1
        w22 = s2
        w25 = s5
      }
    }
    call "Handle Error.gviweb"(Input=w11, Input_2="UI", Output_2=w19) -> (Output_3=w64)
    next s1 = w21
    next s2 = w22
    next s3 = w23
    next s4 = w24
    next s5 = w25
    next s6 = w26
    stop if w20
  }
  Array Index(array=w9) -> (out0["Manager"]=w65, out1["IO"]=w66)
  s9 = uninitialised  # shift register
  s10 = uninitialised  # shift register
  while {
    call "Dequeue Message.gvi"(message queue in=w66, timeout in milliseconds=0, error in=w10) -> (timed out?=w67, message queue out=w68, message=w69, message data=w70, error out=w71)
    # UI Update Loop
    case (w69) ignore case {  # Message Cases
      frame "SW Init" {
        w72 = w71
        w73 = default
        w74 = s9
        w75 = "IO Data.gtype" {all zero or empty}
      }
      frame "Initialize" {
        disable {
          frame Disabled {
            # #Integrate_Hardware
            # Hardware uninitialization goes here
            w76 = w71
          }
          frame Enabled {
            call "globals.gviweb"() -> (Globals=w77)
            Property Node(instance in=w77) -> ("Hardware Initialize Duration (s)"=w78)
            # #debug
            Multiply(w78, 1000) -> w79
            Wait(time to wait=w79)
            w76 = w71
          }
        }
        call "Report Step Complete.gviweb"(Manager Queue=w65, This Queue Name="IO", Step Name=w69, Input_3=w76) -> (Output_2=w72)
        w73 = default
        w74 = s9
        w75 = s10
      }
      frame "Finalize" {
        disable {
          frame Disabled {
            # #Integrate_Hardware
            # Hardware uninitialization goes here
            w80 = w71
          }
          frame Enabled {
            call "globals.gviweb"() -> (Globals=w81)
            Property Node(instance in=w81) -> ("Hardware Finalize Duration (s)"=w82)
            # #debug
            Multiply(w82, 1000) -> w83
            Wait(time to wait=w83)
            w80 = w71
          }
        }
        call "Report Step Complete.gviweb"(Manager Queue=w65, This Queue Name="IO", Step Name=w69, Input_3=w80) -> (Output_2=w72)
        w73 = default
        w74 = s9
        w75 = s10
      }
      frame "Execute" {
        # #todo move some of this functionality to initialization and check if test sequence is empty
        # report empty back to manager
        call "Handle Next Waveform.gviweb"(Test Sequence in=$"Test Steps", IO Data In=s10) -> (Test Sequence out=w74, IO Data out=w75)
        w72 = w71
        w73 = default
      }
      frame "Cancel" {
        sequence {
          frame 0 {
            # Stop IO
            Property Node(instance in=s10, "Wave Active"=FALSE) -> (instance out=w75)
          }
        }
        call "Report Step Complete.gviweb"(Manager Queue=w65, This Queue Name="IO", Step Name=w69, Input_3=w71) -> (Output_2=w72)
        w73 = default
        w74 = s9
      }
      frame "Exit" {
        Release Queue(queue=w68) -> (error out=w84)
        Merge Errors(w71, w84) -> (error out=w72)
        w73 = TRUE
        w74 = s9
        w75 = s10
      }
      frame Default {
        case (w67) {
          frame True {
            Property Node(instance in=s10) -> ("Wave Active"=w85, instance out=w86)
            # No message -> handle output
            case (w85) {
              frame False, Default {
                w75 = w86
                w72 = w71
                w74 = s9
              }
              frame True {
                Property Node(instance in=w86) -> ("New Wave"=w87, instance out=w88)
                case (w87) {
                  frame False, Default {
                    w89 = w88
                  }
                  frame True {
                    Get Current Time() -> (current time=w90)
                    # only save init timestamp at wave start
                    Property Node(instance in=w88, "Start Time"=w90, "New Wave"=FALSE) -> (instance out=w89)
                  }
                }
                call "Generate Waveform.gviweb"(IO Data=w89) -> (Time Elapsed=w91, IO data out=w92, Wave Value=w93, Fraction Complete=w94)
                call "Handle Hardware IO.gviweb"(IO data in=w92, Hardware output=w93, Time Elapsed=w91) -> (IO data out=w95, Hardware input=w96)
                call "Check Test Sequence Complete.gviweb"(This Queue Name="IO", Test Sequence in=s9, IO data in=w95, Fraction Complete=w94, Manager Queue=w65) -> (Test Sequence out=w74, IO data out=w75, Fraction Complete (includes messages)=w97)
                call "Calculate Target Value.gviweb"(Wave Value=w93) -> (Target=w98)
                Build Array(w97, w98, w96) -> w99
                Enqueue Element(element=w99, error in=w71, queue=w6) -> (error out=w72)
              }
            }
          }
          frame False {
            # Received message
            call "Generate Undefined Message Error.gviweb"(Queue Name="IO", Message=w69, Error in=w71) -> (Error out=w72)
            w75 = s10
            w74 = s9
          }
        }
        w73 = default
      }
    }
    call "Handle Error.gviweb"(Input=w65, Input_2="IO", Output_2=w72) -> (Output_3=w100)
    Wait(time to wait=50)
    next s9 = w74
    next s10 = w75
    stop if w73
  }
  Array Index(array=w9) -> (out0["Manager"]=w101)
  call "Define Program Instructions.gviweb"() -> (Instructions=w102, Instruction names=w103)
  s11 = uninitialised  # shift register
  while {
    # w9: Message Queues
    call "Dequeue Message.gvi"(message queue in=w101, error in=w10) -> (message queue out=w104, message=w105, message data=w106, error out=w107)
    # "Manager": Manager Queue Name
    # w4: Stop Event
    # s11: Manager Data
    # w102: Instructions
    # w103: Instruction Names
    case (w105) ignore case {  # Message Cases
      frame "SW Init" {
        w108 = w107
        w109 = default
        w110 = "Manager Data.gtype" {all zero or empty}
      }
      frame "Test Sequence Change" {
        Array Index(array=w9) -> (out0["UI"]=w111)
        call "Enqueue Message (Single).gvi"(message queue in=w111, message="Handle Test Change", message data=w106, error in=w107) -> (error out=w108)
        w109 = default
        w110 = s11
      }
      frame "Error" {
        Variant To Data(error in (no error)=w107, type="Error Data.gtype" {all zero or empty}, variant=w106) -> (data=w112, error out=w113)
        Property Node(instance in=w112) -> ("Error Origin"=w114, "Error In"=w115)
        Property Node(instance in=w115) -> ("code"=w116, "source"=w117)
        w118 = "================\nError\n\nAt: %s\n\nCode: %d\n%s\n================"
        Format Into String(formatString=w118, errIn=w113, w114, w116, w117) -> (outString=w119, errOut=w120)
        call "Append Log Text.gviweb"(Message Queues in=w9, Update Tex=w119, Error in=w120) -> (Error out_2=w108)
        w109 = default
        w110 = s11
      }
      frame "Exit Pressed" {
        # #development
        s12 = w107  # shift register
        for {
          w121 = each element of w9
          call "Enqueue Message (Single).gvi"(message queue in=w121, message="Exit", error in=s12) -> (error out=w122)
          next s12 = w122
        }
        w108 = s12
        w109 = default
        w110 = s11
      }
      frame "Exit" {
        Generate User Event(event data=TRUE, user event=w4) -> (error out=w123)
        Release Queue(queue=w104) -> (error out=w124)
        Merge Errors(w124, w123) -> (error out=w108)
        w109 = TRUE
        w110 = s11
      }
      frame Default {
        call "Generate Undefined Message Error.gviweb"(Queue Name="Manager", Message=w105, Error in=w107) -> (Error out=w108)
        w109 = default
        w110 = s11
      }
      frame "Instruction" {
        # w125: Instruction Name
        Variant To Data(error in (no error)=w107, type=w105, variant=w106) -> (data=w125, error out=w126)
        Search 1D Array(1D array=w103, element=w125) -> (index of element=w127)
        case (w127) {
          frame Default {
            Array Index(array=w102) -> (out0[w127]=w128)
            Property Node(instance in=w128) -> ("Init Info:Valid Starts"=w129, instance out=w130)
            Property Node(instance in=s11) -> ("Current State"=w131, instance out=w132)
            Search 1D Array(1D array=w129, element=w131) -> (index of element=w133)
            # Message in sequence start list -> ensure in valid start state
            case (w133) {
              frame Default {
                # In valid state for recieved message -> react
                Property Node(instance in=w130) -> ("Sequences"=w134)
                Format Into String(formatString="******************\nStart: %s\n******************", errIn=w126, w125) -> (outString=w135, errOut=w136)
                call "Append Log Text.gviweb"(Message Queues in=w9, Update Tex=w135, Error in=w136) -> (Message Queues out=w137, Error out_2=w138)
                call "Handle Next Sequence.gviweb"(Manager data in=w132, Sequences=w134, error in=w138, Message Queues=w137) -> (manager data out=w139, Sequence Steps=w140, End Instruction=w141, error out=w142, Message Queues out=w143)
                case (w141) {
                  frame True {
                    # #verify - new instruction, but sequences empty
                    w144 = "-------------------------------------\nInstruction Sequences Empty\n-------------------------------------"
                    call "Append Log Text.gviweb"(Message Queues in=w143, Update Tex=w144, Error in=w142) -> (Error out_2=w108)
                    w110 = w139
                  }
                  frame False {
                    Property Node(instance in=w139, "Current Instruction"=w125) -> (instance out=w145)
                    # Start first step in first sequence
                    call "Handle Next Step.gviweb"(Manager Data in=w145, Sequence Steps=w140, Error in=w142, Nessage Queues in=w143) -> (Manager Data out=w110, Error out=w108)
                  }
                }
              }
              frame -1 {
                w146 = """-------------------------------------
Received inavalid message for current status

Invalid Message: %s

State: %s
Currently waiting on: %s
-------------------------------------"""
                Property Node(instance in=w132) -> ("Current State"=w147, "Current Step:Message Queue"=w148)
                Format Into String(formatString=w146, errIn=w126, w125, w147, w148) -> (outString=w149, errOut=w150)
                call "Append Log Text.gviweb"(Message Queues in=w9, Update Tex=w149, Error in=w150) -> (Error out_2=w108)
                w110 = w132
              }
            }
          }
          frame -1 {
            # Instruction name missing from list -> undefined
            Format Into String(formatString="Instruction \"%s\" undefined.", w125) -> w151
            call "Build Error Cluster.gvi"(code=1, description=w151, error in=w126) -> (error out=w108)
            w110 = s11
          }
        }
        w109 = default
      }
      frame "Step Complete" {
        Property Node(instance in=s11) -> ("Current Step"=w152)
        Variant To Data(error in (no error)=w107, type=w152, variant=w106) -> (data=w153, error out=w154)
        Is Equal[ComparisonMode=CompareAggregates](x=w152, y=w153) -> w155
        case (w155) {
          frame False, Default {
            w156 = "Unexpected \"Step Complete\" message \n\nFrom: %s with action %s\nExpected: %s with action %s"
            Property Node(instance in=w153) -> ("Message Queue"=w157, "Action"=w158)
            Property Node(instance in=w152) -> ("Message Queue"=w159, "Action"=w160)
            Format Into String(formatString=w156, w157, w158, w159, w160) -> w161
            call "Append Log Text.gviweb"(Message Queues in=w9, Update Tex=w161, Error in=w154) -> (Error out_2=w108)
            w110 = s11
          }
          frame True {
            # Expected complete message received
            Property Node(instance in=s11) -> ("Remaining Steps"=w162, instance out=w163)
            Array Size(array=w162) -> (size(s)=w164)
            Property Node(instance in=w152) -> ("Message Queue"=w165, "Action"=w166)
            Format Into String(formatString="Completed %s %s", errIn=w154, w165, w166) -> (outString=w167, errOut=w168)
            call "Append Log Text.gviweb"(Message Queues in=w9, Update Tex=w167, Error in=w168) -> (Message Queues out=w169, Error out_2=w170)
            case (w164) {
              frame Default {
                # Steps remaining -> handle next step
                call "Handle Next Step.gviweb"(Manager Data in=w163, Sequence Steps=w162, Error in=w170, Nessage Queues in=w169) -> (Manager Data out=w110, Error out=w108)
              }
              frame 0 {
                Property Node(instance in=w163) -> ("Remaining Sequences"=w171, "Current State"=w172, instance out=w173)
                call "Send Sequence Complete UI Updates.gviweb"(Message queues in=w169, Current State=w172, Error In=w170) -> (Message queues out=w174, Error out=w175)
                call "Handle Next Sequence.gviweb"(Manager data in=w173, Sequences=w171, error in=w175, Message Queues=w174) -> (manager data out=w176, Sequence Steps=w177, End Instruction=w178, error out=w179, Message Queues out=w180)
                Property Node(instance in=w176) -> ("Current State"=w181, instance out=w182)
                # Sequence complete -> handle next sequence if it exists
                Format Into String(formatString="%s", errIn=w179, w181) -> (outString=w183, errOut=w184)
                call "Update Program Status.gviweb"(Message Queues in=w180, Status=w183, Error in=w184) -> (Message Queues out=w185, Error out=w186)
                case (w178) {
                  frame False, Default {
                    # Handle next step of next sequence
                    call "Handle Next Step.gviweb"(Manager Data in=w182, Sequence Steps=w177, Error in=w186, Nessage Queues in=w185) -> (Manager Data out=w110, Error out=w108)
                  }
                  frame True {
                    Property Node(instance in=w182) -> ("Current Instruction"=w187, instance out=w188)
                    # No more sequences -> Instruction complete
                    # prevents confusion of manager possibly waiting on another loop
                    Property Node(instance in=w188, "Current Step:Message Queue"="Manager") -> (instance out=w110)
                    Format Into String(formatString="******************\nComplete: %s\n******************", errIn=w186, w187) -> (outString=w189, errOut=w190)
                    call "Append Log Text.gviweb"(Message Queues in=w185, Update Tex=w189, Error in=w190) -> (Error out_2=w108)
                  }
                }
              }
            }
          }
        }
        w109 = default
      }
    }
    call "Handle Error.gviweb"(Input=w104, Input_2="Manager", Output_2=w108) -> (Output_3=w191)
    next s11 = w110
    stop if w109
  }
  Register For Events("Stop Event"=w4) -> (event registration refnum out=w192)
  # #todo
  # hide exit button conditionally with flag - if possible
  # make UI more presentable
  #
  # change status text so instruction, sequence and steps are clearly identifiable
  # 	sequence not to be confused with test sequence (maybe change one to routine?)
  # create/ configure simulation cases/ flags
  # clean up
  # 	UI loop
  # 	IO loop
  # 	save all text log messages in same place
  Array Index(array=w9) -> (out0["Manager"]=w193)
  # This framework behind this sequencer operates by handling instructions in a manager loop. Instructions are initiated by sending an "Instruction" message via the manager's queue (marked with ******************) and checked against a list of valid start states.  In each sequence element in the instruction, a manager state name is defined ("____ Start") and the program status is updated upon reaching that element. The sequence steps are then executed sequentially by sending a message to the corresponding loop ("Waiting on ___ to ___..."), with the manager then expecting a response to indicate each step's completion via the Report Step Complete VI ("Completed ___ ___").  This framework allows for easily reconfigurable program execution with the order of execution being defined as structured overview in a single location. Adding additional step types requires simply adding a corresponding step to a desired loop.
  #
  # Note:
  # - The array nested in program sequences contains the individual steps to be executed, each in turn containing a message queue/ loop name and a message defining the action to be completed.
  # - The final emtpy sequence in the array is used to set the final state of the manager.
  # - The UI loop receives a "___ Complete" upon the conclusion of all steps in any given sequence, with the ___ being the state name.
  # - The names of the step messages do not have to match the name of the manager state for that sequence.
  # - Instructions cannot be queued. There can only be one active at a time.
  # - Instruction names, start states and corresponding sequences are defined and stored in the Define Program Instructions VI, being made available to the manager at program start.
  # Run Test Sequence example
  #
  # State: Idle
  #
  # Start Pressed
  #
  # Initialize
  # 	>> To UI ---Initialize
  # 	Waiting on UI
  # 	>> To IO ---Initialize
  # 	Waiting on IO
  # Execute
  # 	>> To UI ---Execute
  # 	Waiting on UI
  # 	>> To IO ---Execute
  # 	Waiting on IO
  # Finalize
  # 	>> To IO ---Finalize
  # 	Waiting on IO
  # 	>> To UI ---Finalize
  # 	Waiting on UI
  # Idle
  s13 = w192  # shift register
  while {
    event (dynamic events = s13) {
      on "Test Start" Value changed {
        call "Enqueue Message (Single).gvi"(message queue in=w193, message="Instruction", message data="Run Test Sequence") -> (message queue out=w196, error out=w195)
        w194 = default
      }
      on "Cancel" Value changed {
        call "Enqueue Message (Single).gvi"(message queue in=w193, message="Instruction", message data="Cancel") -> (message queue out=w196, error out=w195)
        w194 = default
      }
      on "Exit (development only)" Value changed {
        call "Enqueue Message (Single).gvi"(priority message=TRUE, message queue in=w193, message="Exit Pressed") -> (message queue out=w196, error out=w195)
        w194 = default
      }
      on dynamic event 0 {
        # The Message Handling Loop processed an "Exit" message, which fired this event to stop the Event Handling Loop.
        w194 = TRUE
        w195 = default
        w196 = w193
      }
      on "Test Steps" Value changed {
        Event Data() -> ("New Value"=w197)
        To Variant(anything=w197) -> w198
        call "Enqueue Message (Single).gvi"(message queue in=w193, message="Test Sequence Change", message data=w198) -> (message queue out=w196, error out=w195)
        w194 = default
      }
    }
    call "Error Handler - Event Handling Loop.gvi"(message queue in=w196, error in=w195) -> (dup error in=w199)
    stop if w194
  }
  Unregister For Events(error in=w199, event registration refnum=s13) -> (error out=w200)
  Merge Errors(w200, w191, w64, w100) -> (error out=w201)
  Destroy User Event(error in=w201, user event=w4)
